# Grasshopper definition TimoDS_pipeline.gh (Grasshopper 1.0.8)
# plug-ins: Karamba3D, RhinoCodePluginGH

reload = Button()
clear = Button()

# ---- group: CSV Loader script
csv_loader = Python3Script(reload=reload, clear=clear)  # -> ok, n, headers, KEY; inputs reload: Boolean, clear: Boolean
# ---------- csv_loader: Python ----------
import scriptcontext as sc
import csv
import os

path = r"\input_data_script_V2.csv"
KEY = "input_data_script_V2"

if clear:
    if KEY in sc.sticky:
        sc.sticky.pop(KEY)

if (KEY not in sc.sticky) or reload:
    if not path or not os.path.exists(path):
        raise Exception("Invalid CSV path.")
    with open(path, "r") as f:
        reader = csv.DictReader(f)
        rows = [r for r in reader]
        headers = reader.fieldnames

    sc.sticky[KEY] = {
        "headers": headers,
        "rows": rows,
        "path": path
    }

ok = KEY in sc.sticky
n = len(sc.sticky[KEY]["rows"]) if ok else 0
# ---------- end csv_loader ----------

# ----
csv_upload_info = Panel([csv_loader.ok, csv_loader.n, csv_loader.headers, csv_loader.KEY])
cross_section_range_selector_karamba3d = CroSecRSelect(MaximumHeight_cm=-1, MaximumWidth_cm=-1, menu=[dropdown(1), dropdown(1), dropdown(0)])
load_multiplier = Slider(1, range=1..100)
point = Point("0,0,0")
addition = Addition(A=csv_loader.n, B="-1")
reset = Button()

# ---- group: Index driver to retreive results and store in a csv file
index_driver = Python3Script(start_i="0", end_i=addition, run=Toggle(False), reset=reset)  # -> row_id_out, running, done
# ---------- index_driver: Python ----------
import scriptcontext as sc
import Grasshopper as gh

KEY = "beam_index_driver_v4"

# ---- reset ----
if reset:
    if KEY in sc.sticky:
        sc.sticky.pop(KEY)

# ---- bounds ----
s = int(start_i)
e = int(end_i)
if e < s:
    s, e = e, s

# ---- init ----
if KEY not in sc.sticky:
    sc.sticky[KEY] = {"i": s}

state = sc.sticky[KEY]
i = int(state.get("i", s))

# Clamp
if i < s: i = s
if i > e: i = e

done = (i >= e)
running = False
row_id_out = i

doc = ghenv.Component.OnPingDocument()  # IMPORTANT: correct GH doc

if run and not done:
    running = True
    row_id_out = i

    # increment for next step
    state["i"] = i + 1
    sc.sticky[KEY] = state

    # schedule next solution AND expire this component so it recomputes
    def callback(d):
        ghenv.Component.ExpireSolution(False)

    doc.ScheduleSolution(5, callback)

elif run and done:
    running = False
    row_id_out = e
    state["i"] = e
    sc.sticky[KEY] = state

else:
    # paused
    running = False
    row_id_out = i
    state["i"] = i
    sc.sticky[KEY] = state
# ---------- end index_driver ----------

# ----
status = Panel([index_driver.running, index_driver.done])
row_id_out = Panel(index_driver.row_id_out)

# ---- group: CSV row parsing and distribution
csv_row_getter = Python3Script(KEY=csv_loader.KEY, i=row_id_out)  # -> Lcase, SecID, L, a, kappa_x_A, kappa_x_B, kappa_y_A, kappa_y_B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
# ---------- csv_row_getter: Python ----------
import scriptcontext as sc

if KEY not in sc.sticky:
    raise Exception("CSV not loaded.")

rows = sc.sticky[KEY]["rows"]

i = max(0, min(int(i), len(rows)-1))
r = rows[i]

def f(name):
    try:
        return float(r[name])
    except:
        return r[name]

Lcase = f("Lcase")
SecID = f("SecID")
L = f("L")
a = f("a")

kappa_x_A = f("kappa_x_A")
kappa_y_A = f("kappa_y_A")
kappa_z_A = f("kappa_z_A")
kappa_x_B = f("kappa_x_B")
kappa_y_B = f("kappa_y_B")
kappa_z_B = f("kappa_z_B")

zeta_x_A  = f("zeta_x_A")
zeta_y_A  = f("zeta_y_A")
zeta_z_A  = f("zeta_z_A")
zeta_x_B  = f("zeta_x_B")
zeta_y_B  = f("zeta_y_B")
zeta_z_B  = f("zeta_z_B")
# ---------- end csv_row_getter ----------

# ----
construct_point = ConstructPoint(XCoordinate=csv_row_getter.L, YCoordinate=0, ZCoordinate=0)
cross_section_selector_karamba3d = CroSecSelect(CrossSections=cross_section_range_selector_karamba3d, NameOrListIndexOfCrossSection=csv_row_getter.SecID)  # -> CrossSection, Info
line = Line(StartPoint=point, EndPoint=construct_point)
lcase_parser = Python3Script(Lcase=csv_row_getter.Lcase, mult=load_multiplier)  # -> LC1, LC2, LC3, LC4, LC5, LC6
# ---------- lcase_parser: Python ----------
import scriptcontext as sc

Lcase_vec=[0.0 for i in range(6)]

Lcase_vec[int(Lcase)-1]=1.0

LC1=mult*Lcase_vec[0]
LC2=mult*Lcase_vec[1]
LC3=mult*Lcase_vec[2]
LC4=mult*Lcase_vec[3]
LC5=mult*Lcase_vec[4]
LC6=mult*Lcase_vec[5]

sc.sticky['dummy']='salam'
# ---------- end lcase_parser ----------
vector_xyz = VectorXYZ(XComponent=lcase_parser.LC1, YComponent=lcase_parser.LC2, ZComponent=lcase_parser.LC3)  # -> Vector, Length
vector_xyz_2 = VectorXYZ(XComponent=lcase_parser.LC4, YComponent=lcase_parser.LC5, ZComponent=lcase_parser.LC6)  # -> Vector, Length
disassemble_cross_section_karamba3d = Disassemble(CroSec=cross_section_selector_karamba3d.CrossSection)  # -> CrossSection, FamilyNameOfCrossSection, TypeNameOfCrossSection, ElemIdentifiers, Colour, Material, LocalEccentricity_cm, Heights_cm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
create_linear_element_karamba3d = LineElem(
    Line=line,
    CrossSection=disassemble_cross_section_karamba3d.CrossSection,
    LimitDistance_m=0.005,
    BucklingLengthY_m=-1,
    BucklingLengthZ_m=-1,
    BucklingLengthLT_m=-1,
    Bending=True,
    ToPolylineMaxAngle=0.25,
    ToPolylineTolerance=0.1,
    ToPolylineMaxEdgeLength=0.25,
    New=True,
    Remove=True,
    mode="LineToBeam")  # -> Element, Points, Info
beam_loads_karamba3d = BeamLoads(
    LoadCase="LC0",
    ForceVector=vector_xyz.Vector,
    MomentVector=vector_xyz_2.Vector,
    TPosition=csv_row_getter.a,
    mode="Concentrated",
    menu=[buttons(on, off)])

# ---- group: Stiffness calculator from kappa/zeta to k/c
stiffness_calculator = Python3Script(
    L=csv_row_getter.L,
    S=disassemble_cross_section_karamba3d.Area_cm²,
    Ay=disassemble_cross_section_karamba3d.AreaY_cm²,
    Az=disassemble_cross_section_karamba3d.AreaZ_cm²,
    Iyy=disassemble_cross_section_karamba3d.Iyy_cm⁴,
    Izz=disassemble_cross_section_karamba3d.Izz_cm⁴,
    Jxx=disassemble_cross_section_karamba3d.Ipp_cm⁴,
    kappa_x_A=csv_row_getter.kappa_x_A,
    kappa_x_B=csv_row_getter.kappa_x_B,
    kappa_y_A=csv_row_getter.kappa_y_A,
    kappa_y_B=csv_row_getter.kappa_y_B,
    kappa_z_A=csv_row_getter.kappa_z_A,
    kappa_z_B=csv_row_getter.kappa_z_B,
    zeta_x_A=csv_row_getter.zeta_x_A,
    zeta_x_B=csv_row_getter.zeta_x_B,
    zeta_y_A=csv_row_getter.zeta_y_A,
    zeta_y_B=csv_row_getter.zeta_y_B,
    zeta_z_A=csv_row_getter.zeta_z_A,
    zeta_z_B=csv_row_getter.zeta_z_B)  # -> S, Ay, Az, Iyy, Izz, Jxx, k_x_A, k_x_B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
# ---------- stiffness_calculator: Python ----------
#Unit conversions to m2 and m4

S=S/(100.0)**2
Ay=Ay/(100.0)**2
Az=Az/(100.0)**2

Iyy=Iyy/(100.0)**4
Izz=Izz/(100.0)**4
Jxx=Jxx/(100.0)**4

#Material properties showcase in kN and m

E=210000000.0
poisson=0.33
G=0.5*E/(1+poisson) 

print(E*S/L,E*Iyy/L**3,E*Izz/L**3,G*Jxx/L,E*Iyy/L,E*Izz/L)

k_x_A=kappa_x_A*(E*S/L)
k_x_B=kappa_x_B*(E*S/L)

k_y_A=kappa_y_A*(E*Izz/L**3)
k_y_B=kappa_y_B*(E*Izz/L**3)

k_z_A=kappa_z_A*(E*Iyy/L**3)
k_z_B=kappa_z_B*(E*Iyy/L**3)

c_x_A=zeta_x_A*(G*Jxx/L)
c_x_B=zeta_x_B*(G*Jxx/L)

c_y_A=zeta_y_A*(E*Iyy/L)
c_y_B=zeta_y_B*(E*Iyy/L)

c_z_A=zeta_z_A*(E*Izz/L)
c_z_B=zeta_z_B*(E*Izz/L)
# ---------- end stiffness_calculator ----------

# ----
vector_xyz_3 = VectorXYZ(XComponent=stiffness_calculator.k_x_A, YComponent=stiffness_calculator.k_y_A, ZComponent=stiffness_calculator.k_z_A)  # -> Vector, Length
vector_xyz_4 = VectorXYZ(XComponent=stiffness_calculator.k_x_B, YComponent=stiffness_calculator.k_y_B, ZComponent=stiffness_calculator.k_z_B)  # -> Vector, Length
vector_xyz_5 = VectorXYZ(XComponent=stiffness_calculator.c_x_A, YComponent=stiffness_calculator.c_y_A, ZComponent=stiffness_calculator.c_z_A)  # -> Vector, Length
vector_xyz_6 = VectorXYZ(XComponent=stiffness_calculator.c_x_B, YComponent=stiffness_calculator.c_y_B, ZComponent=stiffness_calculator.c_z_B)  # -> Vector, Length
support_karamba3d = Supp(PosInd=point, Ct_kN_m=vector_xyz_3.Vector, Cr_kNm_rad=vector_xyz_5.Vector, menu=[buttons(off, off, off, off, off, off)])
support_karamba3d_2 = Supp(
    PosInd=construct_point,
    Ct_kN_m=vector_xyz_4.Vector,
    Cr_kNm_rad=vector_xyz_6.Vector,
    menu=[buttons(off, off, off, off, off, off)])
assemble_model_karamba3d = Assemble(
    Elem=create_linear_element_karamba3d.Element,
    Support=[support_karamba3d_2, support_karamba3d],
    Load=beam_loads_karamba3d,
    LimitDistance_m=0.005)  # -> Model, Info, Mass_kg, CentreOfGravity, LoadCaseNames
analyse_karamba3d = Analyse(Model=assemble_model_karamba3d.Model)  # -> AnalysedModel, MaximumDisplacement_cm, ResultingForce_kN, ChangeOfElasticEnergy_kNm
model_view_karamba3d = ModelView(Model=analyse_karamba3d.AnalysedModel)  # -> Model, DeformedMesh, DeformedAxes, DeformedModel, MaximumDeformation
panel = Panel([analyse_karamba3d.MaximumDisplacement_cm, analyse_karamba3d.ChangeOfElasticEnergy_kNm])
beam_view_karamba3d = BeamView(Model=model_view_karamba3d.Model)  # -> Model, MeshesOfRenderedBeams, DeformedBeamAxes, LegendColours, LegendTags
append = BooleanToggle(False)
write = Button()
reset_2 = Button()
range = Range(Domain=Domain(0, 1), Steps="20")
beam_forces_karamba3d = BForces(AnalysedModel=beam_view_karamba3d.Model, Ts=range)  # -> Model, NormalForce_kN, ShearForceVz_kN, ShearForceVy_kN, TorsionalMomentMt_kNm, BendingMomentMy_kNm, BendingMomentMz_kNm, LoadCaseIndex
beam_displacements_karamba3d = BeamDisp(AnalysedModel=beam_view_karamba3d.Model, Ts=range)  # -> Model, Translations_m, Rotations_rad, LoadCaseIndex

# ---- group: Result structuring script
python_3_script = Python3Script(
    Ud=analyse_karamba3d.ChangeOfElasticEnergy_kNm,
    row_id=row_id_out,
    reset=reset_2,
    append=append,
    write=write,
    S=stiffness_calculator.S,
    A_y=stiffness_calculator.Ay,
    A_z=stiffness_calculator.Az,
    I_yy=stiffness_calculator.Iyy,
    I_zz=stiffness_calculator.Izz,
    J_xx=stiffness_calculator.Jxx,
    k_x_A=stiffness_calculator.k_x_A,
    k_x_B=stiffness_calculator.k_x_B,
    k_y_A=stiffness_calculator.k_y_A,
    k_y_B=stiffness_calculator.k_y_B,
    k_z_A=stiffness_calculator.k_z_A,
    k_z_B=stiffness_calculator.k_z_B,
    c_x_A=stiffness_calculator.c_x_A,
    c_x_B=stiffness_calculator.c_x_B,
    c_y_A=stiffness_calculator.c_y_A,
    c_y_B=stiffness_calculator.c_y_B,
    c_z_A=stiffness_calculator.c_z_A,
    c_z_B=stiffness_calculator.c_z_B,
    Disps=beam_displacements_karamba3d.Translations_m,
    Rots=beam_displacements_karamba3d.Rotations_rad,
    Nx=beam_forces_karamba3d.NormalForce_kN,
    Vy=beam_forces_karamba3d.ShearForceVy_kN,
    Vz=beam_forces_karamba3d.ShearForceVz_kN,
    Tx=beam_forces_karamba3d.TorsionalMomentMt_kNm,
    My=beam_forces_karamba3d.BendingMomentMy_kNm,
    Mz=beam_forces_karamba3d.BendingMomentMz_kNm)  # -> count_buffer, count_seen, count_written, auto_flushed, manual_flushed; inputs Disps: list, Rots: list, Nx: list, Vy: list, Vz: list, Tx: list, My: list, Mz: list
# ---------- python_3_script: Python ----------
import scriptcontext as sc
import csv
import os

KEY = "beam_results_v4"
OUT_PATH = r"\beam_results_v4.csv"

STEP = 0.05
NST = 21
CHUNK = 5000

if reset:
    if KEY in sc.sticky:
        sc.sticky.pop(KEY)

if KEY not in sc.sticky:
    headers = [
        "row_id","S","A_y","A_z","I_yy","I_zz","J_xx",
        "k_x_A", "k_x_B", "k_y_A", "k_y_B", "k_z_A", "k_z_B",
        "c_x_A", "c_x_B", "c_y_A", "c_y_B", "c_z_A", "c_z_B",
        "Ud"
    ]

    for prefix in ("ux", "uy", "uz", "rx", "ry", "rz", "Nx", "Vy", "Vz", "Tx", "My", "Mz"):
        for i in range(NST):
            headers.append("%s%.2f" % (prefix, i * STEP))

    sc.sticky[KEY] = {
        "rows": [],              # buffer
        "seen": set(),
        "headers": headers,
        "header_written": False,
        "count_written": 0
    }

state = sc.sticky[KEY]
rows = state["rows"]
seen = state["seen"]
headers = state["headers"]

if isinstance(seen, dict):
    seen = set(seen.keys())
    state["seen"] = seen

def flush_rows():
    if len(rows) == 0:
        return False

    folder = os.path.dirname(OUT_PATH)
    if folder and not os.path.exists(folder):
        os.makedirs(folder)

    mode = "a" if state["header_written"] else "w"

    try:
        f = open(OUT_PATH, mode, newline="")
    except TypeError:
        if mode == "a":
            f = open(OUT_PATH, "ab")
        else:
            f = open(OUT_PATH, "wb")

    try:
        writer = csv.DictWriter(f, fieldnames=headers, lineterminator="\n")

        if not state["header_written"]:
            writer.writeheader()
            state["header_written"] = True

        writer.writerows(rows)
        state["count_written"] += len(rows)

        del rows[:]   # flush buffer in place
        return True
    finally:
        f.close()

if append:
    idx = int(row_id)
    if idx not in seen:

        ux_vals = [v.X for v in Disps]
        uy_vals = [v.Y for v in Disps]
        uz_vals = [v.Z for v in Disps]

        rx_vals = [v.X for v in Rots]
        ry_vals = [v.Y for v in Rots]
        rz_vals = [v.Z for v in Rots]

        Nx_vals = [float(x) for x in Nx]
        Vy_vals = [float(x) for x in Vy]
        Vz_vals = [float(x) for x in Vz]
        Tx_vals = [float(x) for x in Tx]
        My_vals = [float(x) for x in My]
        Mz_vals = [float(x) for x in Mz]

        d = {
            "row_id": idx,
            "S":float(S),
            "A_y":float(A_y),
            "A_z":float(A_z),
            "I_yy":float(I_yy),
            "I_zz":float(I_zz),
            "J_xx":float(J_xx),
            "k_x_A": float(k_x_A),
            "k_x_B": float(k_x_B),
            "k_y_A": float(k_y_A),
            "k_y_B": float(k_y_B),
            "k_z_A": float(k_z_A),
            "k_z_B": float(k_z_B),
            "c_x_A": float(c_x_A),
            "c_x_B": float(c_x_B),
            "c_y_A": float(c_y_A),
            "c_y_B": float(c_y_B),
            "c_z_A": float(c_z_A),
            "c_z_B": float(c_z_B),
            "Ud": float(Ud)
        }

        for i in range(NST):
            a = i * STEP

            d["ux%.2f" % a] = float(ux_vals[i])
            d["uy%.2f" % a] = float(uy_vals[i])
            d["uz%.2f" % a] = float(uz_vals[i])

            d["rx%.2f" % a] = float(rx_vals[i])
            d["ry%.2f" % a] = float(ry_vals[i])
            d["rz%.2f" % a] = float(rz_vals[i])

            d["Nx%.2f" % a] = float(Nx_vals[i])
            d["Vy%.2f" % a] = float(Vy_vals[i])
            d["Vz%.2f" % a] = float(Vz_vals[i])
            d["Tx%.2f" % a] = float(Tx_vals[i])
            d["My%.2f" % a] = float(My_vals[i])
            d["Mz%.2f" % a] = float(Mz_vals[i])

        rows.append(d)
        seen.add(idx)

# auto flush every CHUNK rows
auto_flushed = False
if len(rows) >= CHUNK:
    auto_flushed = flush_rows()

# manual write flushes whatever remains
manual_flushed = False
if write:
    manual_flushed = flush_rows()

count_buffer = len(rows)
count_seen = len(seen)
count_written = state["count_written"]
# ---------- end python_3_script ----------

# ----
panel_2 = Panel([python_3_script.count_buffer, python_3_script.count_seen, python_3_script.count_written, python_3_script.auto_flushed, python_3_script.manual_flushed])
